# Dynamo graph temp.dyn (Dynamo 2.1.0.6141)

width = DoubleSlider(10.1625, range=0..100 step 0.1)  # graph input
length = DoubleSlider(6.7, range=0..100 step 0.1)  # graph input
height = DoubleSlider(21.7, range=0..100 step 0.1)  # graph input
byLengths = Cuboid.ByLengths(width=width, length=length, height=height)
area = Solid.Area(solid=byLengths)
watch = Watch(area)  # graph output
string = StringInput("")
username = StringInput("arefin2")  # graph input
